# Grasshopper definition knot_001(1).gh (Grasshopper 1.0.7)

count = Slider(3, range=2..10)
plane_rotation = Slider(27.622, range=0..100)
_4_tangents = Slider(3.84, range=0..10)
radius = Slider(0.437, range=0..1)
distance = Slider(2.22, range=1..10)
panel = Panel("1")
# Trefoil Knot
# created at Wickerson Studios
# Date: 2/18/2023
panel_2 = Panel("360")
construct_point = ConstructPoint(XCoordinate=distance, YCoordinate=0, ZCoordinate=0)
construct_point_2 = ConstructPoint(XCoordinate=0, YCoordinate=0, ZCoordinate=0)
unit_z = UnitZ(Factor=1)
division = Division(A=panel_2, B=count)
rotate_3d = Rotate3D(Geometry=construct_point, Angle=expr("-x", degrees(division)), Center=construct_point_2, Axis=unit_z)  # -> Geometry, Transform
unit_z_2 = UnitZ(Factor=1)
unit_z_3 = UnitZ(Factor=1)
unit_x = UnitX(Factor=1)
vector_2pt = Vector2Pt(PointA=construct_point_2, PointB=rotate_3d.Geometry, Unitize=False)  # -> Vector, Length
construct_plane = ConstructPlane(Origin=construct_point, XAxis=unit_x, YAxis=unit_z_3)
construct_plane_2 = ConstructPlane(Origin=rotate_3d.Geometry, XAxis=vector_2pt.Vector, YAxis=unit_z_2)
rotate_3d_2 = Rotate3D(Geometry=construct_plane, Angle=expr("-x", degrees(plane_rotation)), Center=construct_point, Axis=unit_x)  # -> Geometry, Transform
rotate_3d_3 = Rotate3D(Geometry=construct_plane_2, Angle=expr("-x", degrees(plane_rotation)), Center=rotate_3d.Geometry, Axis=vector_2pt.Vector)  # -> Geometry, Transform
vector = Vector(rotate_3d_2.Geometry)
vector_2 = Vector(rotate_3d_3.Geometry)
multiplication = Multiplication(A=vector, B=_4_tangents)
multiplication_2 = Multiplication(A=vector_2, B=_4_tangents)
bezier_span = BezierSpan(
    StartPoint=rotate_3d_2.Geometry,
    StartTangent=expr("-x", multiplication),
    EndPoint=rotate_3d_3.Geometry,
    EndTangent=multiplication_2)  # -> Curve, Length, Domain
polar_array = PolarArray(Geometry=bezier_span.Curve, Plane=construct_point_2, Count=count, Angle=6.283185307)  # -> Geometry, Transform
range = Range(Domain=Domain(0, 1), Steps=expr("x-1", count))
pipe = Pipe(Curve=polar_array.Geometry, Radius=radius, Caps=0)
gradient = Gradient(
    LowerLimit=0,
    UpperLimit=1,
    Parameter=range,
    stops=[0: RGB(234, 38, 0), 0.25: RGB(234, 126, 0), 0.5: RGB(254, 244, 84), 0.75: RGB(173, 203, 249), 1: RGB(75, 107, 169)])
flatten_tree = FlattenTree(Tree=pipe, Path="{0}")
brep_join = BrepJoin(Breps=flatten_tree)  # -> Breps, Closed
custom_preview = CustomPreview(Geometry=flatten_tree, Material=gradient)
panel_3 = Panel(brep_join.Breps)
