# Grasshopper definition knot_001.gh (Grasshopper 1.0.7)

plane_rotation = Slider(0, range=0..100)
count = Slider(3, range=2..10)
_4_tangents = Slider(4.34, range=0..10)
distance = Slider(1, range=1..10)
pi = Pi(Factor=plane_rotation)
# Trefoil Knot
# created at Wickerson Studios
# Date: 2/18/2023
panel = Panel("360")
construct_point = ConstructPoint(XCoordinate=distance, YCoordinate=0, ZCoordinate=0)
construct_point_2 = ConstructPoint(XCoordinate=0, YCoordinate=0, ZCoordinate=0)
unit_z = UnitZ(Factor=1)
division = Division(A=panel, B=count)
rotate_3d = Rotate3D(Geometry=construct_point, Angle=expr("-x", degrees(division)), Center=construct_point_2, Axis=unit_z)  # -> Geometry, Transform
unit_z_2 = UnitZ(Factor=1)
unit_z_3 = UnitZ(Factor=1)
unit_x = UnitX(Factor=1)
vector_2pt = Vector2Pt(PointA=construct_point_2, PointB=rotate_3d.Geometry, Unitize=False)  # -> Vector, Length
construct_plane = ConstructPlane(Origin=construct_point, XAxis=unit_x, YAxis=unit_z_3)
construct_plane_2 = ConstructPlane(Origin=rotate_3d.Geometry, XAxis=vector_2pt.Vector, YAxis=unit_z_2)
rotate_3d_2 = Rotate3D(Geometry=construct_plane, Angle=expr("-x", degrees(pi)), Center=construct_point, Axis=unit_x)  # -> Geometry, Transform
rotate_3d_3 = Rotate3D(Geometry=construct_plane_2, Angle=expr("-x", degrees(pi)), Center=rotate_3d.Geometry, Axis=vector_2pt.Vector)  # -> Geometry, Transform
vector = Vector(rotate_3d_2.Geometry)
vector_2 = Vector(rotate_3d_3.Geometry)
multiplication = Multiplication(A=vector, B=_4_tangents)
multiplication_2 = Multiplication(A=vector_2, B=_4_tangents)
bezier_span = BezierSpan(
    StartPoint=rotate_3d_2.Geometry,
    StartTangent=expr("-x", multiplication),
    EndPoint=rotate_3d_3.Geometry,
    EndTangent=multiplication_2)  # -> Curve, Length, Domain
polar_array = PolarArray(Geometry=bezier_span.Curve, Plane=construct_point_2, Count=count, Angle=6.283185307)  # -> Geometry, Transform
pipe = Pipe(Curve=polar_array.Geometry, Radius=Slider(0.232, range=0..1), Caps=0)
flatten_tree = FlattenTree(Tree=pipe, Path="{0}")
brep_join = BrepJoin(Breps=flatten_tree)  # -> Breps, Closed
panel_2 = Panel(brep_join.Breps)
deconstruct_brep = DeconstructBrep(Brep=flatten_tree)  # -> Faces, Edges, Vertices
divide_domain² = DivideDomain²(Domain=deconstruct_brep.Faces, UCount=Slider(10, range=0..10), VCount="1")
isotrim = Isotrim(Surface=deconstruct_brep.Faces, Domain=divide_domain²)
list_length = ListLength(List=flatten(isotrim))
range = Range(Domain=Domain(0, 1), Steps=expr("x-1", list_length))
gradient = Gradient(
    LowerLimit=0,
    UpperLimit=1,
    Parameter=range,
    stops=[0: RGB(243, 57, 0), 0.1: RGB(236, 27, 60), 0.2: RGB(210, 0, 118), 0.3: RGB(103, 0, 120), 0.4: RGB(39, 72, 161), 0.5: RGB(1, 192, 229), 0.6: RGB(18, 178, 90), 0.7: RGB(79, 186, 8), 0.8: RGB(220, 237, 32), 0.9: RGB(247, 159, 20), 1: RGB(243, 57, 0)])
custom_preview = CustomPreview(Geometry=flatten(isotrim), Material=gradient)
