# Grasshopper definition knot_002.gh (Grasshopper 1.0.7)

plane_rotation = Slider(14.468, range=0..100)
count = Slider(3, range=2..10)
_4_tangents = Slider(3.68, range=0..10)
distance = Slider(0.53932, range=0..10)
pi = Pi(Factor=plane_rotation)
# Trefoil Knot
# created at Wickerson Studios
# Date: 2/18/2023
# 24 sections
panel = Panel("360")
construct_point = ConstructPoint(XCoordinate=distance, YCoordinate=0, ZCoordinate=0)
construct_point_2 = ConstructPoint(XCoordinate=0, YCoordinate=0, ZCoordinate=0)
unit_z = UnitZ(Factor=1)
division = Division(A=panel, B=count)
rotate_3d = Rotate3D(Geometry=construct_point, Angle=expr("-x", degrees(division)), Center=construct_point_2, Axis=unit_z)  # -> Geometry, Transform
unit_z_2 = UnitZ(Factor=1)
unit_z_3 = UnitZ(Factor=1)
unit_x = UnitX(Factor=1)
vector_2pt = Vector2Pt(PointA=construct_point_2, PointB=rotate_3d.Geometry, Unitize=False)  # -> Vector, Length
construct_plane = ConstructPlane(Origin=construct_point, XAxis=unit_x, YAxis=unit_z_3)
construct_plane_2 = ConstructPlane(Origin=rotate_3d.Geometry, XAxis=vector_2pt.Vector, YAxis=unit_z_2)
rotate_3d_2 = Rotate3D(Geometry=construct_plane, Angle=expr("-x", degrees(pi)), Center=construct_point, Axis=unit_x)  # -> Geometry, Transform
rotate_3d_3 = Rotate3D(Geometry=construct_plane_2, Angle=expr("-x", degrees(pi)), Center=rotate_3d.Geometry, Axis=vector_2pt.Vector)  # -> Geometry, Transform
vector = Vector(rotate_3d_2.Geometry)
vector_2 = Vector(rotate_3d_3.Geometry)
multiplication = Multiplication(A=vector, B=_4_tangents)
multiplication_2 = Multiplication(A=vector_2, B=_4_tangents)
bezier_span = BezierSpan(
    StartPoint=rotate_3d_2.Geometry,
    StartTangent=expr("-x", multiplication),
    EndPoint=rotate_3d_3.Geometry,
    EndTangent=multiplication_2)  # -> Curve, Length, Domain
polar_array = PolarArray(Geometry=bezier_span.Curve, Plane=construct_point_2, Count=count, Angle=6.283185307)  # -> Geometry, Transform
list_item = ListItem(List=polar_array.Geometry, Index=0, Wrap=True)
cull_index = CullIndex(List=polar_array.Geometry, Indices="0", Wrap=True)
divide_curve = DivideCurve(Curve=list_item, Count="12", Kinks=False)  # -> Points, Tangents, Parameters
shatter = Shatter(Curve=cull_index, Parameters=divide_curve.Parameters)
pipe = Pipe(Curve=shatter, Radius=Slider(0.5559, range=0..1), Caps=0)
cap_holes = CapHoles(Brep=pipe)
